# Grasshopper definition CW4.0_WP1_Form_Finding.gh (Grasshopper 1.0.7)
# plug-ins: jSwan, Swiftlet, LunchBox

slider = Slider(150, range=1..1000)

series = Series(Start=Slider(1, range=0..1), Step=1, Count=10)
concat = Concatenate(FragmentA="p", FragmentB=series)

python = GhPythonScript(x=slider)  # -> out, a; inputs x: Int32
# ---------- python: Python ----------
from datetime import datetime

a = []
for i in range(x):
    a.append(datetime.now().strftime("%Y-%m-%d %H:%M:%S"))
# ---------- end python ----------
cluster = Cluster(count=slider)  # -> genelist_a_2, genelist_b_2, genelist_c_2, C, genelist_g_2

width = Slider(20, range=0..100)
height = Slider(2, range=0..100)
priority = Slider(1, range=0..1)
length = Slider(100, range=0..100)
priority_2 = Slider(2, range=0..2)
length_2 = Slider(100, range=0..100)
width_2 = Slider(20, range=0..100)
height_2 = Slider(2, range=0..100)
merge = Merge(Data1=priority, Data2=length, Data3=width, Data4=height)
merge_2 = Merge(Data1=priority_2, Data2=length_2, Data3=width_2, Data4=height_2)
merge_3 = Merge(Data1="priority", Data2="length", Data3="height", Data4="width")
rejsonkv = SerializeKeysAndValues(Key=merge_3, Value=merge)
rejsonkv_2 = SerializeKeysAndValues(Key=merge_3, Value=merge_2)
rejsonkv_3 = SerializeKeysAndValues(Key=simplify(graft(concat)), Value=rejsonkv)  # -> flatten(JSON)
rejsonkv_4 = SerializeKeysAndValues(Key="parts", Value=rejsonkv_3)
rejsonkv_5 = SerializeKeysAndValues(Key="name", Value="Javid")
jmerge = MergeJson(SourceJson=rejsonkv_5, OverrideJson=rejsonkv_4)
panel = Panel(jmerge)

multiplication = Multiplication(A=cluster.genelist_a_2, B=cluster.genelist_b_2, C=cluster.genelist_c_2)
division = Division(A=multiplication, B=10000000)
division_2 = Division(A=cluster.genelist_g_2, B=1000)
division_3 = Division(A=division_2, B=division)

# ---- group: POST data to DB
# Post API call  to Database
entwine = Entwine(
    Branch00=cluster.genelist_a_2,
    Branch01=cluster.genelist_b_2,
    Branch02=cluster.genelist_c_2,
    Branch03=cluster.genelist_g_2,
    Branch04=division_3,
    Branch05=cluster.C,
    Branch06=python.a,
    FlattenInputs=True)  # -> simplify(Result)
panel_2 = Panel("""length
width
height
weight
density
color
timestamp""")
flip = FlipMatrix(Data=entwine)
rejsonkv_6 = SerializeKeysAndValues(Key=panel_2, Value=flip)  # -> flatten(JSON)
get_string = GetString(rejsonkv_6, AtLeast=1, AtMost=2147483647)
ctb = CreateTextBody(
    Content=get_string,
    IsHtmlChecked=False,
    IsJavascriptChecked=False,
    IsJsonChecked=True,
    IsTextChecked=False,
    IsXmlChecked=False)
post = POSTRequest(URL="http://127.0.0.1:5000/residual_wood", Body=ctb)  # -> Status, Content, Response; disabled

# ---- group: GET data from DB
# Get API request from Database
panel_3 = Panel("http://127.0.0.1:5000/residual_wood")
get = GETRequest(URL=panel_3)  # -> Status, Content, Response
dejson = DeserializeJson(JSON=get.Content, OutputsLocked=False)
dejson_2 = DeserializeJson(JSON=dejson, OutputsLocked=False)  # -> Color, Density, Height, Id, Length, Timestamp, Weight, Width

# ----
number_slider = Slider(6, range=0..10)
srf = Surface(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)
diagrid = DiagridStructure(Surface=srf, UDivisions=number_slider, VDivisions=number_slider, Type=True)  # -> StructureLines, StructureNodes
crv = Curve([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])

# ---- group: INITIAL DESIGN
crv_2 = Curve(crv)

# ----
# Selection from Database based on Nearest Length
maximum_preselection = Slider(70, range=0..100)
series_2 = Series(Start=Slider(1000, range=0..2000), Step=1, Count=maximum_preselection)
len = Length(Curve=crv_2)
item = ListItem(List=dejson_2.Length, Index=series_2, Wrap=True)
item_2 = ListItem(List=dejson_2.Id, Index=series_2, Wrap=True)
data = Data(len)
sort = SortList(Keys=data, ValuesA=crv_2)  # -> Keys, ValuesA
python_2 = GhPythonScript(design_lengths=sort.Keys, database_lengths=item)  # -> nearest_lengths; inputs design_lengths: list, database_lengths: list
# ---------- python_2: Python ----------
__author__ = "Javid Jooshesh, j.jooshesh@hva.nl"
__version__ = "v1"


def find_nearest(array, value):
    return array[min(range(len(array)), key = lambda i: abs(array[i] - value))]


def search(base_array, array_to_search_from):
    found_closest_values = []
    hashset = set()

    # Copy the search array to not lose the original data from the array
    new_search_target_array = []
    for i in array_to_search_from:
        new_search_target_array.append(i)

    while len(new_search_target_array) > len(array_to_search_from) / 2:
        for item in base_array:
            closest = find_nearest(new_search_target_array, item)
            if closest in hashset:
                continue
            else:
                hashset.add(closest)
                new_search_target_array.remove(closest)
                if len(found_closest_values) < len(base_array):
                    found_closest_values.append(closest)

    return found_closest_values
    
    
nearest_lengths = search(design_lengths, database_lengths)
print(len(nearest_lengths))
# ---------- end python_2 ----------
keysearch = KeyValueSearch(Keys=item, Values=item_2, Search=python_2)
index = ItemIndex(List=dejson_2.Id, Item=keysearch)
item_3 = ListItem(List=dejson, Index=index, Wrap=True)
dejson_3 = DeserializeJson(JSON=item_3, OutputsLocked=False)  # -> Color, Density, Height, Id, Length, Timestamp, Weight, Width

rectangle = Rectangle(Plane=PlaneXY(0, 0, 0), XSize=Slider(114, range=20..2000), YSize=Slider(104, range=0..140), Radius=0)  # -> Rectangle, Length
Z = UnitZ(Factor=Slider(17, range=0..100))
extr = Extrude(Base=rectangle.Rectangle, Direction=Z)
cap = CapHoles(Brep=extr)
rot3d = Rotate3D(
    Geometry=cap,
    Angle=degrees(Slider(0, range=0..45)),
    Center=Point(0, 0, 0),
    Axis=Vector(206.8690586, 288.6243865, 137.3901748))  # -> Geometry, Transform
brep = Brep(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)

# ----
# Wood from Database
number_slider_2 = Slider(30, range=0..100)
lng = ListLength(List=dejson_3.Id)
pt = ConstructPoint(XCoordinate=0, YCoordinate=expr("x*2", Slider(100, range=0..100)), ZCoordinate=0)
series_3 = Series(Start=0, Step=number_slider_2, Count=lng)
Y = UnitY(Factor=series_3)
move = Move(Geometry=pt, Motion=Y)  # -> Geometry, Transform
rectangle_2 = Rectangle(Plane=move.Geometry, XSize=dejson_3.Length, YSize=dejson_3.Width, Radius=0)  # -> Rectangle, Length
boxrec = BoxRectangle(Rectangle=rectangle_2.Rectangle, Height=dejson_3.Height)

ratio = Slider(8.091, range=0..10)
sort_2 = SortList(Keys=dejson_3.Id, ValuesA=boxrec)  # -> Keys, ValuesA

length_tolerance = Slider(8.855, range=0..10)
python_3 = GhPythonScript(
    wood_from_db=sort_2.ValuesA,
    design_boundary=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,
    edge_index=1,
    height=17,
    heights=dejson_3.Height,
    srf_index=5,
    line_segment=crv_2,
    tolerane=length_tolerance,
    ratio_tolerance=ratio)  # -> evaluated_points, all_blocks, packed_indecies, packed_selection, normal, linear_indecies, ratios, available_length; inputs wood_from_db: list, edge_index: Int32, heights: list, srf_index: Int32, line_segment: list
# ---------- python_3: Python ----------
__author__ = "Javid Jooshesh, j.jooshesh@hva.nl"
__version__ = "v1"

import ghpythonlib.treehelpers as th
import rhinoscriptsyntax as rs
import Grasshopper.Kernel.Data as ghp
import Grasshopper.Kernel.Geometry.Plane as gh_plane


class Blocks:
    """_Class representing the wood plank geometries from the database_
    Attributes:
        source (DataTree[Breps]) : The list of box breps as a Grasshopper
            datatree
    Methods:
        explode_polysrf: ...
        explode_srf: ...
        get_block_length: ...
        get_block_width: ...
    """

    def __init__(self, source):
        """_Constructor of the class_
        Args:
            source (DataTree[objectid]) : The list of box breps
                as a Grasshopper datatree
        """

        self.source = source

    def __str__(self):
        return "A Class to Represent the Functions of " \
               "Form-Fitting for the Circular Wood Blocks from Scanned Database"

    def explode_polysrf(self):
        """Explode a brep object into the NURBS untrimmed surfaces"""
        p = []
        for i in range(len(self.source)):
            trimmed_srf = rs.ExplodePolysurfaces(self.source[i])
            blocks = []
            for srf in trimmed_srf:
                blocks.append(srf)
            p.append(blocks)
        data = th.list_to_tree(p, source=[0])
        return data

    def explode_srf(self):
        """Explode the surface into line segments"""
        p = []
        listed_tree = th.tree_to_list(self.explode_polysrf())
        curve = None
        for i in range(len(listed_tree)):
            curve_segments = []
            for j in range(len(listed_tree[i])):
                curve = rs.DuplicateEdgeCurves(listed_tree[i][j])
                curve_segments.append(curve)
            p.append(curve_segments)
        data = th.list_to_tree(p, source=[0])
        return data

    def get_block_length(self, position=2):
        """Return the length of the block as float. BigO(n^2)
            (not the most efficient way but it works for now)
        """
        list_of_lengths = []
        curves = th.tree_to_list(self.explode_srf())
        for i in range(len(curves)):
            blocks = []
            for j in range(len(curves[i])):
                lengths = []
                for k in range(len(curves[i][j])):
                    l = rs.CurveLength(curves[i][j][k])
                    lengths.append(l)
            blocks.append(sorted(lengths)[position])
            list_of_lengths.append(blocks)

        lengths_data_tree = th.list_to_tree(list_of_lengths, source=[0])
        return lengths_data_tree

    def get_block_width(self, position=1):
        """Return the width of the block as float"""
        widths = self.get_block_length(position=position)
        return widths
        
    def get_block_height(self, position=3):
        heights = self.get_block_length(position=position)
        return heights
    
    
class DesignModel:
    """_Class representing the design object and methods to fit the wood planks
    that are varaible in dimensions, within the boundary of the design_

    Attributes:
        design_region (DesignRegion) : The boundary of design
        blocks (Blocks) : The box breps representing the wood planks from the
            database
    Methods:
        orient: ...
        fit_blocks: ...
    """

    def __init__(self, design_region, blocks, heights, srf_index):
        """_Constructor method_"""

        self.region = DesignRegion(design_region, 0)
        self.srf_index = srf_index
        self.blocks = Blocks(blocks)
        self.blocks_list = self.blocks.source
        self.design_region_brep = design_region
        self.blocks_brep = blocks
        self.blocks_length = self.blocks.get_block_length()
        self.blocks_width = self.blocks.get_block_width()
        self.blocks_height = heights

        self.index_list = []
        self.edge = self.region.find_edge(1, self.srf_index)
        self.selection = []
        self.flatten_values()
    
    def flatten_values(self):
        """_Flatten the Length, Width and Height values_"""
        
        flatten_path_width = ghp.GH_Path(0)
        self.blocks_width.Flatten(flatten_path_width)
        flatten_path_length = ghp.GH_Path(0)
        self.blocks_length.Flatten(flatten_path_length)
        flatten_path_height = ghp.GH_Path(0)
        self.blocks_length.Flatten(flatten_path_height)

    def orient(self, index_list, positions):
        """_Orient the block across the selected edge_

        Args:
            index_list (list) : The list of indexes of elements to orient
        Returns:
            oriented (list) : The list of oriented elements
        """

        block_edges = [
            th.tree_to_list(self.blocks.explode_srf())[i][3][0] for i in range(
                len(self.blocks.source)
            )
        ]

        st_points_orient_blocks = [
            [rs.CurvePoints(edge) for edge in block_edges][i][1] for i in range(
                len(block_edges)
            )
        ]

        end_points_orient_blocks = [
            [rs.CurvePoints(edge) for edge in block_edges][i][0] for i in range(
                len(block_edges)
            )
        ]

        z_points_blocks = [
            rs.MoveObject(rs.CopyObject(point), [0, 0, 1]) for point in st_points_orient_blocks
        ]

        st_pt_edge = None

        oriented = []
        for i in range(len(positions)):
            st_pt_edge = positions[i]
            
            end_pt_edge = rs.CurvePoints(self.edge)[0]
            z_points_boundary = rs.MoveObject(rs.CopyObject(st_pt_edge), [0, 0, 1])
            j = index_list[i]
            oriented.append(
                rs.OrientObject(self.blocks.source[j],
                                [end_points_orient_blocks[j], st_points_orient_blocks[j], z_points_blocks[j]],
                                [st_pt_edge, end_pt_edge, z_points_boundary]
                                )
            )
        return oriented

    def fit_blocks(self, available_length, available_width, available_height):
        """_Create a sublist of what is suitable for populating in the boundary
        of the design. For now the criteria can be the top widths that the addition of them
        would be less than the available length of the edge_
        """
        
        evaluated_points = []
        blocks_dicts = {}
        
        widths = th.tree_to_list(self.blocks_width)  # Python list
        lengths = th.tree_to_list(self.blocks_length) # Python list
        
        target_edge = self.region.find_edge(1, self.srf_index)
        
        for i in range(len(self.blocks.source)):
            wlh = (widths[i], lengths[i], heights[i])
            blocks_dicts[wlh] = self.blocks.source[i]

        constant_length = available_length
        initial_pos = 0.0

        for wlh, block in blocks_dicts.items():
            width = wlh[0]
            length = wlh[1]
            height = wlh[2]
            
            if (
                width <= available_length
                and length <= available_width
                and height <= available_height
            ):
                self.selection.append(block)
                remaining = width / constant_length
                
                parameter = rs.CurveParameter(target_edge, remaining)
                points_on_curve = rs.EvaluateCurve(target_edge, parameter)
                
                point_a = rs.CurvePoints(self.edge)[0]
                point_b = rs.CurvePoints(self.edge)[1]
                
                vector_3d = rs.VectorCreate(point_a, point_b)
                v = rs.VectorUnitize(vector_3d)
                scaled_vector = rs.VectorScale(v, initial_pos)
                rs.MoveObject(points_on_curve, scaled_vector)
                evaluated_points.append(points_on_curve)
                initial_pos -= width

                del blocks_dicts[wlh]
                for index, item in enumerate(self.blocks.source):
                    if item == block:
                        self.index_list.append(index)
                available_length -= width
        
        self.orient(self.index_list, evaluated_points)

        return evaluated_points
        

class DesignRegion:
    def __init__(self, brep, index):
        self.brep = brep
        self.index = index

    def explode(self):
        return rs.ExplodePolysurfaces(self.brep)

    def select_lowest_face(self):
        """Sort the faces of the Brep according to lowest `z` value of the
            centroids
        """
        exploded_surfaces = self.explode()
        z_coords = list()
        lowest_srf = None
        for i in range(len(exploded_surfaces)):
            centriod = rs.SurfaceAreaCentroid(exploded_surfaces[i])
            z_values = centriod[0][2]
            z_coords.append(z_values)
            if z_values == min(z_coords):
                lowest_srf = exploded_surfaces[i]
        return lowest_srf
    
    def select_custom_face(self, selected_index):
        exploded_surfaces = self.explode()
        for index, item in enumerate(exploded_surfaces):
            if index == selected_index:
                return item
    
    def find_edge(self, edge_index, surface_index):
        """Get the edge to populate blocks across within the design boundary"""
        selected_face = self.select_custom_face(surface_index)
        for index, item in enumerate(rs.DuplicateEdgeCurves(selected_face)):
            if index == edge_index:
                return item
                

class LinearElement:
    def __init__(self, line, blocks, used_blocks_index):
        self.blocks = Blocks(blocks)
        self.line = []
        for l in line:
            self.line.append(l)

        self.length = [rs.CurveLength(l) for l in self.line]
        self.start_point = [rs.CurvePoints(l)[0] for l in self.line]
        self.end_point = [rs.CurvePoints(l)[1] for l in self.line]
        self.normal_axis = []
        self.normal = []

        for i in range(len(self.start_point)):
            self.normal_axis.append(rs.VectorCreate(self.end_point[i], self.start_point[i]))
            self.normal.append(rs.PlaneFromNormal(self.start_point[i], self.normal_axis[i]))
        self.selection = []
        self.index_list = []
        self.used_index = used_blocks_index
        self.base = None
            
    def filter_used_blocks(self):
        unused_indexes = []
        for index in range(len(self.blocks.source)):
            if index in self.used_index:
                continue
            unused_indexes.append(index)
        return unused_indexes
    
    def pick_element(self, available_length, tolerane, r_tolerance):
        """_Select elements to build linear parts. Check the ratio
            of width and height as well_"""

        blocks_dict = {}    # blocks_dict = {lengths: blocks}
        lengths = th.tree_to_list(self.blocks.get_block_length())   # Python list
        
        filtered_blocks = self.filter_used_blocks()
        list_of_available_blocks = [self.blocks.source[i] for i in filtered_blocks]

        self.base = [rs.ExplodePolysurfaces(b)[1] for b in list_of_available_blocks]
        heights = [rs.SurfaceDomain(b, 1)[1] for b in self.base]
        widths = [rs.SurfaceDomain(b, 0)[1] for b in self.base]

        ratio = [widths[i] / heights[i] for i in range(len(heights))]

        for i in range(len(list_of_available_blocks)):
            if 0.5 < ratio[i] < r_tolerance:
                length = lengths[i][0]
                blocks_dict[length] = list_of_available_blocks[i]

        length_range = [range(int(l - (tolerane * 3)), int(l + (tolerane * 3))) for l in available_length]

        block_list = []
        for i in range(len(length_range)):
            inner = []
            for key, value in blocks_dict.items():
                if int(key) in length_range[i]:
                    inner.append((value, key))
                    
                    self.selection.append(value)
                    del blocks_dict[key]
                    for index, item in enumerate(list_of_available_blocks):
                        if item == value:
                            self.index_list.append(index)
            block_list.append(inner)
        return th.list_to_tree(block_list[:], source=[0])


if __name__ == "__main__":
    objects = Blocks(wood_from_db)
    des_boundary = DesignRegion(design_boundary, 0)

    edge = des_boundary.find_edge(edge_index, srf_index)
    edge_2 = des_boundary.find_edge(0, srf_index)
    edge_3 = des_boundary.find_edge(1, srf_index)
    length = rs.CurveLength(edge)
    width = rs.CurveLength(edge_2)

    test = DesignModel(design_boundary, wood_from_db, heights, srf_index)

    evaluated_points = test.fit_blocks(length, width, height)
    all_blocks = test.blocks.source
    packed_indecies = test.index_list
    packed_selection = test.selection

    normal = []
    li = []

    a = LinearElement(line_segment, wood_from_db, packed_indecies)
    available_length = []
        
    for i in line_segment:
        available_length.append(rs.CurveLength(i))

    ratios = a.pick_element(available_length, tolerane, ratio_tolerance)
    normal.append(a.normal)
    li.append(a.index_list)

    linear_indecies = th.list_to_tree(li, source=[0])
    linear_selection = a.selection
    normal = th.list_to_tree(normal, source=[0])
# ---------- end python_3 ----------

debrep = DeconstructBrep(Brep=rot3d.Geometry)  # -> Faces, Edges, Vertices
item_4 = ListItem(List=debrep.Faces, Index=4, Wrap=True)
evalsrf = EvaluateSurface(Surface=reparameterize(item_4), Point="{1.0, 1.0, 0.0}")  # -> Point, Normal, UDirection, VDirection, Frame
deplane = DeconstructPlane(Plane=evalsrf.Frame)  # -> Origin, XAxis, YAxis, ZAxis
pl = ConstructPlane(Origin=python_3.evaluated_points, XAxis=deplane.XAxis, YAxis=deplane.YAxis)
pflip = FlipPlane(Plane=pl, ReverseX=invert(False), ReverseY=invert(False), SwapAxes=True)

lng_2 = ListLength(List=crv_2)
series_4 = Series(Start=0, Step=1, Count=lng_2)
item_5 = ListItem(List=python_3.linear_indecies, Index=series_4, Wrap=True)

debrep_2 = DeconstructBrep(Brep=python_3.packed_selection)  # -> Faces, Edges, Vertices
item_6 = ListItem(List=debrep_2.Faces, Index=Slider(5, range=0..6), Wrap=True)
evalsrf_2 = EvaluateSurface(Surface=reparameterize(item_6), Point="{0.0, 0.0, 0.0}")  # -> Point, Normal, UDirection, VDirection, Frame
deplane_2 = DeconstructPlane(Plane=evalsrf_2.Frame)  # -> Origin, XAxis, YAxis, ZAxis
pl_2 = ConstructPlane(Origin=graft(deplane_2.Origin), XAxis=deplane_2.XAxis, YAxis=deplane_2.YAxis)
pflip_2 = FlipPlane(Plane=pl_2, ReverseX=False, ReverseY=False, SwapAxes=True)

orient = Orient(Geometry=python_3.packed_selection, Source=flatten(pflip_2), Target=pflip)  # -> Geometry, Transform
replace = ReplaceItems(List=python_3.all_blocks, Item=orient.Geometry, Indices=python_3.packed_indecies, Wrap=False)

cull_i = CullIndex(List=replace, Indices=python_3.packed_indecies, Wrap=True)
item_7 = ListItem(List=replace, Index=python_3.packed_indecies, Wrap=True)

# ---- group: API call to remove the used wood based on ID
# DELETE from Database
panel_4 = Panel("http://127.0.0.1:5000/residual_wood")

# ----
clean = CleanTree(RemoveNulls=True, RemoveInvalid=True, RemoveEmpty=invert(False), Tree=simplify(python_3.ratios))
data_2 = Data(sort.ValuesA)
item_8 = ListItem(List=clean, Index=0, Wrap=True)  # -> flatten(Item), flatten(Item1)
sort_3 = SortList(Lengths=item_8.Item1, ValuesBlocks=item_8.Item)  # -> Sorted_lengths, ValuesBlocks
sort_4 = SortList(Keys=python_3.available_length)  # -> Keys, ValuesA

# ---- group: Find closest lengths
python_4 = GhPythonScript(design_lengths=sort_4.Keys, database_lengths=item_8.Item1)  # -> nearest_lengths; inputs design_lengths: list, database_lengths: list
# ---------- python_4: Python ----------
__author__ = "Javid Jooshesh, j.jooshesh@hva.nl"
__version__ = "v1"


def find_nearest(array, value):
    return array[min(range(len(array)), key = lambda i: abs(array[i] - value))]


def search(base_array, array_to_search_from):
    found_closest_values = []
    hashset = set()

    # Copy the search array to not lose the original data from the array
    new_search_target_array = []
    for i in array_to_search_from:
        new_search_target_array.append(i)

    while len(new_search_target_array) > len(array_to_search_from) / 2:
        for item in base_array:
            closest = find_nearest(new_search_target_array, item)
            if closest in hashset:
                continue
            else:
                hashset.add(closest)
                found_closest_values.append(closest)
                new_search_target_array.remove(closest)

    return found_closest_values
    
    
nearest_lengths = search(design_lengths, database_lengths)
# ---------- end python_4 ----------

# ----
keysearch_2 = KeyValueSearch(Keys=sort_3.Sorted_lengths, Values=sort_3.ValuesBlocks, Search=python_4)
index_2 = ItemIndex(List=python_3.all_blocks, Item=keysearch_2)

data_3 = Data(keysearch_2)
debrep_3 = DeconstructBrep(Brep=data_3)  # -> Faces, Edges, Vertices
item_9 = ListItem(List=debrep_3.Faces, Index=0, Wrap=True)  # -> Item, Item1
md_slider = MDSlider(SliderMode=0, slider_value=Point(0.5, 0.5, 0.5), x_domain=Domain(0, 1), y_domain=Domain(0, 1), z_domain=Domain(0, 1))
data_4 = Data(item_9.Item1)
evalsrf_3 = EvaluateSurface(Surface=reparameterize(data_4), Point=md_slider)  # -> Point, Normal, UDirection, VDirection, Frame
pflip_3 = FlipPlane(Plane=data_2, ReverseX=False, ReverseY=False, SwapAxes=True)
orient_2 = Orient(Geometry=data_3, Source=flatten(evalsrf_3.Frame), Target=pflip_3)  # -> Geometry, Transform

replace_2 = ReplaceItems(List=cull_i, Item=orient_2.Geometry, Indices=item_5, Wrap=False)
geo = Geometry(simplify([replace_2, item_7]))
preview = CustomPreview(Geometry=geo, Material=cluster.C)

# ---- group: OUTPUT TO BAKE
geo_2 = Geometry(orient_2.Geometry)

# ----
preview_2 = CustomPreview(Geometry=geo_2, Material=cluster.C)

# ---- group: API call to remove the used wood based on ID (continued)
item_10 = ListItem(List=dejson_3.Id, Index=index_2, Wrap=True)

# ---- group: API call to remove the used wood based on ID / Removed Indecies
data_5 = Data(item_10)

# ---- group: API call to remove the used wood based on ID (continued)
concat_2 = Concatenate(FragmentA=panel_4, FragmentB="/", FragmentA_2=data_5)
delete = DELETERequest(URL=concat_2)  # -> Status, Content, Response; disabled
panel_5 = Panel(delete.Response)

# ---- group: ANALYTICS
eval = EvaluateCurve(Curve=reparameterize(data_2), Parameter=Slider(0.4, range=0..1))  # -> Point, Tangent, Angle
midpt = CurveMiddle(Curve=data_2)
move_2 = Move(Geometry=eval.Point, Motion=Vector(0, 0, 10))  # -> Geometry, Transform
sort_5 = SortList(Keys=sort_4.Keys, ValuesA=midpt)  # -> Keys, ValuesA
python_5 = GhPythonScript(anchor=sort_4.Keys, data=sort_3.Sorted_lengths)  # -> a; inputs anchor: list, data: list
# ---------- python_5: Python ----------
"""_Analitics_"""

def analyze(anchor, data):

    values = tuple(zip(anchor, data))
    diff = [values[i][1] - values[i][0] for i in range(len(anchor))]
    
    percentages = [
            "% " + str(round((diff[i] / anchor[i]) * 100, 2))
            for i in range(len(anchor))
        ]
    return percentages

a = analyze(anchor, data)
# ---------- end python_5 ----------
yz = YZPlane(Origin=sort_5.ValuesA)
data_6 = Data(item_3)
txt = Text(data_6)
tag = TextTag(Location=yz, Text=python_5, Colour=ColourSwatch(SwatchColor=RGB(255, 255, 255)))

# ----
yz_2 = YZPlane(Origin=move_2.Geometry)

# ---- group: ANALYTICS (continued)
tag_2 = TextTag3D(
    Location=yz_2,
    Text=txt,
    Size=Slider(1.646, range=0..10),
    Colour=ColourSwatch(SwatchColor=RGB(0, 255, 229)),
    Justification=7)

# ==== cluster Cluster
count = ClusterInput()

vb = VBScript(genelist="GeneList D", count=count)  # -> out, A
# ---------- vb: VB ----------
    For Each obj As IGH_DocumentObject In owner.OnPingDocument().Objects
      If (obj.ComponentGuid <> New Guid("{21553c44-ea62-475e-a8bb-62b2a3ee5ca5}")) Then Continue For
      If (obj.NickName Like genelist) Then
        CallByName(obj, "Count", CallType.Set, count)
        'CallByName(obj, "ExpireSolution", CallType.Method, False)
        Return
      End If
    Next

    Print("No matching Gene list object found")
# ---------- end vb ----------
vb_2 = VBScript(genelist="GeneList E", count=count)  # -> out, A; same code as vb
vb_3 = VBScript(genelist="GeneList F", count=count)  # -> out, A; same code as vb
vb_4 = VBScript(genelist="GeneList G", count=count)  # -> out, A; same code as vb
genelist_d = GeneList(
    Decimals=2,
    Maximum=255,
    Minimum=200,
    Value=[249.6870825, 227.159727, 220.7125882, 221.879463, 240.3877779, 247.7977078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])
genelist_e = GeneList(
    Decimals=2,
    Maximum=140,
    Minimum=120,
    Value=[123.301908, 126.2742014, 136.988057, 120.8476593, 139.8469819, 137.5064603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])
genelist_f = GeneList(
    Decimals=2,
    Maximum=90,
    Minimum=20,
    Value=[47.66573956, 64.54453612, 31.81359346, 80.80078899, 53.74216505, 67.76083834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])
genelist_g = GeneList(
    Decimals=2,
    Maximum=1000,
    Minimum=120,
    Value=[449.58535, 864.1659569, 128.0886553, 422.1313001, 285.0884081, 694.9051328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])
rgb = ColourRGB(Alpha=150, Red=genelist_d, Green=genelist_e, Blue=genelist_f)

vb_5 = VBScript(genelist="GeneList B", count=count)  # -> out, A; same code as vb
vb_6 = VBScript(genelist="GeneList A", count=count)  # -> out, A; same code as vb
vb_7 = VBScript(genelist="GeneList C", count=count)  # -> out, A; same code as vb
genelist_g_2 = ClusterOutput(genelist_g)

genelist_b = GeneList(
    Decimals=2,
    Maximum=25,
    Minimum=10,
    Value=[12.45964517, 16.22955736, 16.59533649, 24.94149932, 21.25182636, 15.86132147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])
genelist_a = GeneList(
    Decimals=2,
    Maximum=130,
    Minimum=65,
    Value=[110.1079261, 127.5222101, 79.09224119, 71.29592327, 100.0396714, 70.91961242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])
genelist_c = GeneList(
    Decimals=2,
    Maximum=15,
    Minimum=5,
    Value=[6.846723883, 7.060112074, 10.99263069, 10.21351632, 5.445522228, 9.19751168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])

C = ClusterOutput(rgb)
genelist_b_2 = ClusterOutput(genelist_b)
genelist_a_2 = ClusterOutput(genelist_a)
genelist_c_2 = ClusterOutput(genelist_c)
